# Grasshopper definition display_conduit.gh (Grasshopper 1.0.7)

# ---- group: turn off display conduit
c_script = CSharpScript(doIt=Button())  # -> out, A; inputs doIt: Boolean
# ---------- c_script: C# ----------
    if (doIt){
      string key = "ksteinfe";
      Rhino.Display.DisplayConduit conduit = Rhino.RhinoDoc.ActiveDoc.RuntimeData.TryGetValue<Rhino.Display.DisplayConduit>(key);
      if (conduit != null){
        conduit.Enabled = false;
        Print(conduit.ToString());
      }
    }
# ---------- end c_script ----------

# ----
c_script_2 = CSharpScript(doIt=Button())  # -> out, A; inputs doIt: Boolean
# ---------- c_script_2: C# usings ----------
using Rhino.Display;
# ---------- c_script_2: C# ----------
    if (doIt){
      // Here's a function that creates a new value instance
      Func<RhinoDoc, MyConduit> initFunc = (doc) => new MyConduit();

      // Call GetValue function with a key and function to create new value if key is not found or value is null
      string key = "ksteinfe";
      MyConduit conduit = Rhino.RhinoDoc.ActiveDoc.RuntimeData.GetValue(key, initFunc);

      //Rhino.Display.DisplayConduit conduit = new MyConduit();
      //Rhino.RhinoDoc.ActiveDoc.RuntimeData.Add("ksteinfe", conduit);


      try{
        conduit.Enabled = true;
      } catch {

      } finally {
        //conduit.Enabled = false;
      }
    }
# ---------- c_script_2: C# additional code ----------
  
  void disableRuntimeConduit(){
    string key = "ksteinfe";
    Rhino.Display.DisplayConduit conduit = Rhino.RhinoDoc.ActiveDoc.RuntimeData.TryGetValue<Rhino.Display.DisplayConduit>(key);
    if (conduit != null){
      conduit.Enabled = false;
      Print(conduit.ToString());
    } 
  }
  
  
  class MyConduit : Rhino.Display.DisplayConduit
  {
    protected override void CalculateBoundingBox(CalculateBoundingBoxEventArgs e)
    {
      base.CalculateBoundingBox(e);
      var bbox = new BoundingBox();
      bbox.Union(new Point3d(0, 0, 0));
      e.IncludeBoundingBox(bbox);
    }

    protected override void PostDrawObjects(DrawEventArgs e)
    {
      base.PostDrawObjects(e);

      var cPlane = e.Display.Viewport.ConstructionPlane();
      var xColor = Rhino.ApplicationSettings.AppearanceSettings.GridXAxisLineColor;
      var yColor = Rhino.ApplicationSettings.AppearanceSettings.GridXAxisLineColor;
      var zColor = Rhino.ApplicationSettings.AppearanceSettings.GridZAxisLineColor;

      e.Display.EnableDepthWriting(false);
      e.Display.EnableDepthTesting(false);

      Point3d loc = new Point3d(10, 10, 10);

      e.Display.DrawPoint(loc, System.Drawing.Color.White);
      e.Display.DrawArrow(new Line(loc, new Vector3d(cPlane.XAxis) * 12.0), xColor);
      e.Display.DrawArrow(new Line(loc, new Vector3d(cPlane.YAxis) * 10.0), yColor);
      e.Display.DrawArrow(new Line(loc, new Vector3d(cPlane.ZAxis) * 10.0), zColor);

      e.Display.EnableDepthWriting(false);
      e.Display.EnableDepthTesting(false);
    }
  }
# ---------- end c_script_2 ----------
panel = Panel(c_script_2.out)
panel_2 = Panel(c_script.out)
