# Grasshopper definition semantic_map.gh (Grasshopper 1.0.7)

c_script = CSharpScript(doIt=Button(), savePath="D:\\GitHub\\stochastic_2023\\230801")  # -> out, A; inputs doIt: Boolean, savePath: String
# ---------- c_script: C# usings ----------
using System.IO;
using System.Drawing;
using Rhino.DocObjects;
# ---------- c_script: C# ----------
    string timestamp = DateTime.Now.ToString("yyMMdd_HHmmss");


    if (doIt){

      var doc = RhinoDoc.ActiveDoc;
      var colorSettings = new Dictionary<Guid, Tuple<Color, ObjectColorSource>>();

      // Iterate over every object in the Rhino model and store its ObjectColor and ColorSource
      foreach (var rhinoObject in doc.Objects)
      {
        colorSettings[rhinoObject.Id] = Tuple.Create(rhinoObject.Attributes.ObjectColor, rhinoObject.Attributes.ColorSource);
      }

      // Iterate over each object and change the ObjectColor to blue and the ColorSource to ColorFromObject
      foreach (var rhinoObject in doc.Objects)
      {
        Print(String.Format("Object ID: {0}", rhinoObject.Id));
        
        //var userDict = rhinoObject.Attributes.UserDictionary; // Get the user dictionary
        var userStrings = rhinoObject.Attributes.GetUserStrings(); // Get the user strings

        foreach (var key in userStrings.AllKeys)
        {
          string value = userStrings.GetString(key);
          Print(String.Format("Key: {1}, Value: {2}", key, value));
        }
        
        // Iterate over each key-value pair in the user dictionary
        /*
        foreach (var key in userDict.Keys)
        {
          string value = userDict[key].ToString();
          Print(String.Format("Key: {1}, Value: {2}", key, value));
        }
  */

        rhinoObject.Attributes.ColorSource = ObjectColorSource.ColorFromObject;
        rhinoObject.Attributes.ObjectColor = Color.Blue;
        rhinoObject.CommitChanges();
      }

      doc.Views.Redraw(); // Make sure changes are redrawn


      // Capture Bitmap
      Rhino.Display.RhinoView view = RhinoDoc.ActiveDoc.Views.ActiveView;
      if (view == null) return;

      Bitmap bmp = null;
      if (doCaptureFlatColorBitmap(view, ref bmp)){
        bmp.Save(Path.Combine(savePath, timestamp + ".png"));
      }


      // Iterate over each object and restore the previous settings
      foreach (var rhinoObject in doc.Objects)
      {
        if (colorSettings.ContainsKey(rhinoObject.Id))
        {
          var colorSetting = colorSettings[rhinoObject.Id];
          rhinoObject.Attributes.ObjectColor = colorSetting.Item1;
          rhinoObject.Attributes.ColorSource = colorSetting.Item2;
          rhinoObject.CommitChanges();
        }
      }


      doc.Views.Redraw(); // Make sure changes are redrawn


    }
# ---------- c_script: C# additional code ----------
  public bool doCaptureFlatColorBitmap(Rhino.Display.RhinoView view, ref Bitmap bitmap){

    Guid userDisplayModeId = view.ActiveViewport.DisplayMode.Id;

    Guid displayModeId = new Guid();
    if (createTempFlatColorDisplayMode(ref displayModeId)){
      try {
        Print(String.Format("Capturing view with temporary displaymode {0}", displayModeId.ToString()));
        view.ActiveViewport.DisplayMode = Rhino.Display.DisplayModeDescription.GetDisplayMode(displayModeId);
        Rhino.Display.DisplayModeDescription dispModeDescription = Rhino.Display.DisplayModeDescription.GetDisplayMode(displayModeId);
        bitmap = view.CaptureToBitmap(new Size(512, 512), dispModeDescription);
        if (bitmap != null) return true;
        Print("doCaptureFlatColorBitmap: Bitmap was null");
      } catch (Exception ex) {
        Print("A main function exception occurred: " + ex.Message);
      } finally {
        view.ActiveViewport.DisplayMode = Rhino.Display.DisplayModeDescription.GetDisplayMode(userDisplayModeId);
        Rhino.Display.DisplayModeDescription.DeleteDisplayMode(displayModeId);
      }
    }
    return false;

  }


  public bool createTempFlatColorDisplayMode(ref Guid displayModeId){
    string filePathINI = "";
    string guidStr = ""; // we don't really need this, since we get the GUID from the import operation below
    createTempFlatColorINIFile(ref filePathINI, ref guidStr);
    //Print(filePathINI);

    try {
      displayModeId = Rhino.Display.DisplayModeDescription.ImportFromFile(filePathINI);
      removeTempFlatColorINIFile(filePathINI);
      return true;
    } catch (Exception ex){
      Print("createTempDisplayMode exception occurred: " + ex.Message);
      removeTempFlatColorINIFile(filePathINI);
      return false;
    }
  }


  public bool createTempFlatColorINIFile(ref string fPath, ref string guidStr)
  {

    Guid newGuid = Guid.NewGuid(); // Generate a new GUID
    string guidString = newGuid.ToString();
    string str = flatColorDispmodeIniString(guidString);

    string tempPath = Path.GetTempPath(); // Define the path for the .ini file in the temp directory
    string filePath = Path.Combine(tempPath, guidString + ".ini");

    File.WriteAllText(filePath, str); // Write the text into the file

    fPath = filePath; // Output the filepath and the GUID
    guidStr = guidString;
    return true;
  }


  public bool removeTempFlatColorINIFile(string fPath)
  {
    try
    {
      if (File.Exists(fPath))
      {
        File.Delete(fPath);
        return true;
      }
      else { Print(String.Format("removeTempINIFile: file does not exist {0}", fPath)); }
    }
    catch (Exception ex) { Print("removeTempINIFile error: " + ex.Message); }
    return false;
  }


  public string flatColorDispmodeIniString(string guidString)
  {
    string ret = @"[DisplayMode\[[GUID]]]
      SupportsShadeCmd=y
      SupportsShading=y
      SupportsStereo=y
      AddToMenu=y
      AllowObjectAssignment=y
      ShadedPipelineRequired=y
      WireframePipelineRequired=y
      PipelineLocked=n
      Order=10
      DerivedFrom=8bc8debe-c83b-4c47-b13c-9db074510cac
      Name=TEMPORARY
      XrayAllObjects=n
      IgnoreHighlights=n
      DisableConduits=n
      DisableTransparency=n
      BBoxMode=0
      RealtimeDisplayId=00000000-0000-0000-0000-000000000000
      PipelineId=952b2830-ce8a-4b4f-935a-8cd570d162c7
      [DisplayMode\[[GUID]]\View settings]
      UseDocumentGrid=n
      DrawGrid=n
      DrawAxes=n
      DrawZAxis=n
      DrawWorldAxes=n
      ShowGridOnTop=n
      ShowTransGrid=n
      BlendGrid=n
      GridTrans=60
      DrawTransGridPlane=n
      GridPlaneTrans=90
      PlaneVisibility=0
      AxesPercentage=100
      PlaneUsesGridColor=n
      GridPlaneColor=0,0,0
      WorldAxesColor=0
      WxColor=150,75,75
      WyColor=75,150,75
      WzColor=0,0,150
      GroundPlaneUsage=1
      CustomGroundPlaneShow=n
      CustomGroundPlaneAltitude=0
      CustomGroundPlaneAutomaticAltitude=y
      CustomGroundPlaneShadowOnly=y
      LinearWorkflowUsage=1
      CustomLinearWorkflowPreProcessColors=n
      CustomLinearWorkflowPreProcessTextures=n
      CustomLinearWorkflowPostProcessFrameBuffer=n
      CustomLinearWorkflowPreProcessGamma=1
      CustomLinearWorkflowPostProcessGamma=1
      FillMode=2
      SolidColor=0,0,0
      GradTopLeft=200,200,200
      GradBotLeft=140,140,140
      GradTopRight=200,200,200
      GradBotRight=140,140,140
      BackgroundBitmap=
      StereoModeEnabled=0
      StereoSeparation=1
      StereoParallax=1
      AGColorMode=0
      AGViewingMode=0
      FlipGlasses=n
      ShowClippingPlanes=n
      ClippingShowXSurface=y
      ClippingShowXEdges=y
      ClippingClipSelected=y
      ClippingShowCP=y
      ClippingSurfaceUsage=0
      ClippingEdgesUsage=0
      ClippingCPUsage=0
      ClippingCPTrans=95
      ClippingEdgeThickness=3
      ClippingSurfaceColor=128,128,128
      ClippingEdgeColor=0,0,0
      ClippingCPColor=255,255,255
      HorzScale=1
      VertScale=1
      [DisplayMode\[[GUID]]\Shading]
      CullBackfaces=n
      ShadeVertexColors=n
      SingleWireColor=n
      WireColor=0,0,0
      ShadeSurface=y
      UseObjectMaterial=n
      UseObjectBFMaterial=n
      BakeTextures=y
      ShowDecals=y
      SurfaceColorWriting=y
      ShadingEffect=0
      ParallelLineWidth=2
      ParallelLineSeparation=3
      ParallelLineRotation=0
      [DisplayMode\[[GUID]]\Shading\Material]
      UseBackMaterial=y
      FrontIsCustom=n
      BackIsCustom=n
      [DisplayMode\[[GUID]]\Shading\Material\Front Material]
      FlatShaded=n
      OverrideObjectColor=n
      OverrideObjectTransparency=y
      OverrideObjectReflectivity=y
      Diffuse=255,255,255
      Shine=0
      Specular=255,255,255
      Transparency=0
      Reflectivity=0
      ShineIntensity=100
      Luminosity=0
      [DisplayMode\[[GUID]]\Shading\Material\Front Material\EmapTexture]
      Filename=rhino_shaded_mode_emap_background.png
      TextureID=00000000-0000-0000-0000-000000000000
      BlendAmount=0.3
      Mode=3
      Type=86
      WrapU=0
      WrapV=0
      WrapW=0
      MagFilter=1
      MinFilter=1
      TextureOn=y
      Transform=1,0,0,0,0,1,0,0,0,0,1,0,0,0,0,1
      [DisplayMode\[[GUID]]\Shading\Material\Back Material]
      FlatShaded=n
      OverrideObjectColor=y
      OverrideObjectTransparency=y
      OverrideObjectReflectivity=y
      Diffuse=1,1,1
      Shine=0
      Specular=255,255,255
      Transparency=0
      Reflectivity=0
      ShineIntensity=100
      Luminosity=0
      [DisplayMode\[[GUID]]\Lighting]
      ShowLights=n
      UseHiddenLights=n
      UseLightColor=n
      LightingScheme=0
      Luminosity=0
      AmbientColor=25,25,25
      LightCount=3
      Light1Direction=1,5,-15
      Light1Color=190,190,190
      Light1Specular=64,64,64
      Light2Direction=-10,5,2
      Light2Color=128,128,128
      Light2Specular=32,32,32
      Light3Direction=1,-4,0
      Light3Color=128,128,128
      Light3Specular=64,64,64
      CastShadows=n
      ShadowMapSize=2048
      SkylightShadowQuality=4
      NumSamples=4
      ShadowMapType=2
      ShadowBitDepth=32
      ShadowColor=0,0,0
      ShadowIntensity=100
      ShadowBias=10,12,0
      ShadowBlur=0
      TransparencyTolerance=40
      PerPixelLighting=n
      ShadowClippingUsage=0
      ShadowClippingRadius=0
      [DisplayMode\[[GUID]]\Objects]
      CPSolidLines=n
      CPSingleColor=n
      CPHidePoints=n
      CPHideSurface=n
      CPHighlight=y
      CPHidden=n
      nCPWireThickness=1
      nCVSize=3
      eCVStyle=102
      CPColor=0,0,0
      GhostLockedObjects=n
      LockedTrans=50
      LockedUsage=2
      LockedColor=100,100,100
      LockedObjectsBehind=n
      LayersFollowLockUsage=n
      [DisplayMode\[[GUID]]\Objects\Surfaces]
      SurfaceKappaHair=n
      HighlightSurfaces=n
      ShowIsocurves=n
      IsoThicknessUsed=n
      IsocurveThickness=1
      IsoUThickness=1
      IsoVThickness=1
      IsoWThickness=1
      SingleIsoColor=n
      IsoColor=0,0,0
      IsoColorsUsed=n
      IsoUColor=0,0,0
      IsoVColor=0,0,0
      IsoWColor=0,0,0
      IsoPatternUsed=n
      IsocurvePattern=-1
      IsoUPattern=-1
      IsoVPattern=-1
      IsoWPattern=-1
      ShowEdges=y
      ShowNakedEdges=n
      ShowTangentEdges=n
      ShowTangentSeams=n
      ShowNonmanifoldEdges=n
      ShowEdgeEndpoints=n
      EdgeThickness=2
      EdgeColorUsage=0
      NakedEdgeOverride=0
      NakedEdgeThickness=1
      NakedEdgeColorUsage=0
      EdgeColorReduction=0
      NakedEdgeColorReduction=0
      EdgeColor=0,0,0
      NakedEdgeColor=0,0,0
      NonmanifoldEdgeColor=0,0,0
      EdgePattern=-1
      NakedEdgePattern=-1
      NonmanifoldEdgePattern=-1
      [DisplayMode\[[GUID]]\Objects\Meshes]
      HighlightMeshes=n
      SingleMeshWireColor=n
      MeshWireColor=0,0,0
      MeshWireThickness=1
      MeshWirePattern=-1
      ShowMeshWires=n
      ShowMeshVertices=n
      MeshVertexSize=0
      ShowMeshEdges=n
      ShowMeshNakedEdges=n
      ShowMeshNonmanifoldEdges=n
      MeshEdgeThickness=2
      MeshNakedEdgeThickness=2
      MeshNonmanifoldEdgeThickness=0
      MeshEdgeColorReduction=0
      MeshNakedEdgeColorReduction=0
      MeshNonmanifoldEdgeColorReduction=0
      MeshEdgeColor=0,0,0
      MeshNakedEdgeColor=0,0,0
      MeshNonmanifoldEdgeColor=0,0,0
      [DisplayMode\[[GUID]]\Objects\SubD]
      SmoothVisible=n
      SmoothUsage=0
      SmoothColor=255,255,255
      SmoothColorReduction=0
      SmoothThickness=1
      CreaseVisible=n
      CreaseUsage=0
      CreaseColor=255,255,255
      CreaseColorReduction=0
      CreaseThickness=2
      NonmanifoldVisible=n
      NonmanifoldUsage=0
      NonmanifoldColor=255,255,255
      NonmanifoldColorReduction=0
      NonmanifoldThickness=1
      BoundaryVisible=n
      BoundaryUsage=0
      BoundaryColor=255,255,255
      BoundaryColorReduction=0
      BoundaryThickness=2
      ShowReflectedPlane=n
      ShowSymmetryAxis=y
      PlaneColorUsage=2
      SymmetryAxisThickness=0.0625
      ReflectedColor=64,64,64
      ColorPercentage=30
      AxisColor=255,0,0
      [DisplayMode\[[GUID]]\Objects\Curves]
      ShowCurvatureHair=n
      ShowCurves=n
      SingleCurveColor=n
      CurveColor=0,0,0
      CurveThickness=1
      CurveTrans=0
      CurvePattern=-1
      LineEndCapStyle=0
      LineJoinStyle=0
      [DisplayMode\[[GUID]]\Objects\Points]
      PointSize=3
      PointStyle=102
      ShowPoints=n
      ShowPointClouds=n
      PCSize=2
      PCStyle=50
      PCGripSize=2
      PCGripStyle=102
      [DisplayMode\[[GUID]]\Objects\Annotations]
      ShowText=n
      ShowAnnotations=n
      DotTextColor=-1
      DotBorderColor=-1
      [DisplayMode\[[GUID]]\Objects\Technical]
      TechnicalMask=47
      TechnicalUsageMask=0
      THThickness=1
      TEThickness=1
      TSiThickness=1
      TCThickness=1
      TSThickness=1
      TIThickness=1
      THColor=0,0,0
      TEColor=0,0,0
      TSiColor=0,0,0
      TCColor=0,0,0
      TSColor=0,0,0
      TIColor=0,0,0";

    return ret.Replace("[[GUID]]", guidString);
  }
# ---------- end c_script ----------
panel = Panel(c_script.out)
